# Grasshopper definition RC大空間設計_1層_STB.ghx (Grasshopper 1.0.8)
# plug-ins: STB Grasshopper

# ----
# 4. 材料特性の指定
# ブレース
# 梁・柱
# 基礎梁
# 水平ブレース
panel = Panel("Column_1F_C")
panel_2 = Panel("Column_1F_K")
panel_3 = Panel("Column_1F_H")
panel_4 = Panel("Beam_f_Kout")
panel_5 = Panel("Beam_f_Kin")
panel_6 = Panel("Beam_f_HoutS")
panel_7 = Panel("Beam_f_HoutC")
panel_8 = Panel("Beam_f_HinS")
panel_9 = Panel("Beam_f_HinC")
A = Slider(1000000, range=0..1000000)
B = Slider(2, range=1..3)
B_2 = Slider(2, range=1..3)
panel_10 = Panel("Beam_K2F_A")
panel_11 = Panel("Beam_H2F_S")
division = Division(A=A, B=B)
division_2 = Division(A="2170", B=B_2)
stb_mat = STbMat(Name="RC_E2170", E=21700, G=10850, Gamma=78.5, Alpha=1.2e-05, Fy=235)
stb_mat_2 = STbMat(Name="Rigid_E1e6", E=10000000, G=5000000, Gamma=78.5, Alpha=1.2e-05, Fy=235)
panel_12 = Panel("1FBraceS")
panel_13 = Panel("1FBraceC")
panel_14 = Panel("Hor_Brace")
panel_15 = Panel("0")
stb_mat_3 = STbMat(Name="RC_E2170_noW", E=21700, G=10850, Gamma=0, Alpha=1.2e-05, Fy=235)
stb_mat_4 = STbMat(Name="Rigid_E1e6_noW", E=10000000, G=5000000, Gamma=0, Alpha=1.2e-05, Fy=235)
mat = STbMat([stb_mat_3, stb_mat, stb_mat_2, stb_mat_4])

panel_17 = Panel("Beam_H2F_C")
panel_18 = Panel("Beam_K2F_D")

# ----
# ブレース材（RC壁置換）：1F外側スパン7.5m
# ブレース材（RC壁置換）：2F外側スパン7.5m
# ブレース材（RC壁置換）：1F中央側スパン7.0m
# ブレース材（RC壁置換）：2F中央側スパン7.0m
せい_cm = Slider(60, range=0..100)
幅_cm = Slider(95.3, range=0..120)
せい_cm_2 = Slider(60, range=0..100)
幅_cm_2 = Slider(103.2, range=0..120)
multiplication = Multiplication(A=せい_cm, B="10")
multiplication_2 = Multiplication(A=幅_cm, B="10")
multiplication_3 = Multiplication(A=せい_cm_2, B="10")
multiplication_4 = Multiplication(A=幅_cm_2, B="10")
stb_sec = STbSection(Name="BR_1F_C", STbMat=stb_mat_3, B=multiplication_2, H=multiplication, SectionType=0)
stb_sec_2 = STbSection(Name="BR_1F_S", STbMat=stb_mat_3, B=multiplication_4, H=multiplication_3, SectionType=0)
幅_cm_3 = Slider(95.4, range=0..120)
せい_cm_3 = Slider(60, range=0..100)
せい_cm_4 = Slider(60, range=0..100)
幅_cm_4 = Slider(101.6, range=0..120)
panel_23 = Panel("2FBraceS")
panel_24 = Panel("2FBraceC")
multiplication_5 = Multiplication(A=せい_cm_4, B="10")
multiplication_6 = Multiplication(A=幅_cm_4, B="10")
multiplication_7 = Multiplication(A=せい_cm_3, B="10")
multiplication_8 = Multiplication(A=幅_cm_3, B="10")
stb_sec_3 = STbSection(Name="BR_2F_S", STbMat=stb_mat_3, B=multiplication_6, H=multiplication_5, SectionType=0)  # disabled
stb_sec_4 = STbSection(Name="BR_2F_C", STbMat=stb_mat_3, B=multiplication_8, H=multiplication_7, SectionType=0)  # disabled

# ----
# 5. 部材断面の指定
# 基礎梁
# 大梁（RFL梁）
# 大梁（2FL梁）
# 1F柱：梁間構面
# 1F柱：桁行構面
# 1F柱：コーナー
# 2F柱：桁行構面
# 2F柱：梁間構面
# 2F柱：コーナー
# 水平ブレース ※編集不要
# 各部材断面の設定に関して
# 
# ・部材断面の設定の時だけ単位は「cm」なことに注意してください
# ・断面形状「Trapezoid」は台形断面です。Upper/Lower Width（上/下幅）を同じ値にすることで長方形断面として扱えます
# 　荷重拾いのExcelファイルとは幅せいの入力順が異なるので注意
# ・2FL梁、RFL梁はどちらも授業では「大梁」という名称で説明しているので同じ寸法としてよいと思います
# ・各ブレース材は置き換えている壁の大きさにより断面が異なると思うので、別途Excelファイルで求めた寸法を入力してください
panel_25 = Panel("Beam_f_Kout")
せい_cm_5 = Slider(130, range=0..200)
幅_cm_5 = Slider(60, range=0..100)
x軸方向_cm = Slider(50, range=0..100)
y軸方向_cm = Slider(80, range=0..100)
幅_cm_6 = Slider(15, range=0..100)
panel_28 = Panel("Column_1F_C")
x軸方向_cm_2 = Slider(50, range=0..100)
y軸方向_cm_2 = Slider(80, range=0..100)
せい_cm_6 = Slider(100, range=0..100)
panel_29 = Panel("Column_2F_C")
multiplication_9 = Multiplication(A=せい_cm_5, B="10")
multiplication_10 = Multiplication(A=幅_cm_5, B="10")
multiplication_11 = Multiplication(A=x軸方向_cm, B="10")
multiplication_12 = Multiplication(A=y軸方向_cm, B="10")
multiplication_13 = Multiplication(A=x軸方向_cm_2, B="10")
multiplication_14 = Multiplication(A=y軸方向_cm_2, B="10")
multiplication_15 = Multiplication(A=せい_cm_6, B="10")
multiplication_16 = Multiplication(A=幅_cm_6, B="10")
stb_sec_5 = STbSection(Name="FG_基礎梁", STbMat=stb_mat_2, B=multiplication_10, H=multiplication_9, SectionType=0)
stb_sec_6 = STbSection(Name="C_1F_C", STbMat=stb_mat, B=multiplication_12, H=multiplication_11, SectionType=0)
stb_sec_7 = STbSection(Name="C_2F_C", STbMat=stb_mat, B=multiplication_14, H=multiplication_13, SectionType=0)  # disabled
stb_sec_8 = STbSection(Name="HB_水平ブレース", STbMat=stb_mat_4, B=multiplication_16, H=multiplication_15, SectionType=0)
せい_cm_7 = Slider(80, range=0..100)
幅_cm_7 = Slider(40, range=0..100)
y軸方向_cm_3 = Slider(50, range=0..100)
x軸方向_cm_3 = Slider(80, range=0..100)
x軸方向_cm_4 = Slider(80, range=0..100)
y軸方向_cm_4 = Slider(50, range=0..100)
panel_34 = Panel("Column_2F_K")
multiplication_17 = Multiplication(A=x軸方向_cm_3, B="10")
multiplication_18 = Multiplication(A=y軸方向_cm_3, B="10")
multiplication_19 = Multiplication(A=x軸方向_cm_4, B="10")
multiplication_20 = Multiplication(A=y軸方向_cm_4, B="10")
multiplication_21 = Multiplication(A=せい_cm_7, B="10")
multiplication_22 = Multiplication(A=幅_cm_7, B="10")
stb_sec_9 = STbSection(Name="C_1F_K", STbMat=stb_mat, B=multiplication_18, H=multiplication_17, SectionType=0)
stb_sec_10 = STbSection(Name="C_2F_K", STbMat=stb_mat, B=multiplication_20, H=multiplication_19, SectionType=0)  # disabled
stb_sec_11 = STbSection(Name="G_2F", STbMat=stb_mat, B=multiplication_22, H=multiplication_21, SectionType=0)
せい_cm_8 = Slider(80, range=0..100)
幅_cm_8 = Slider(40, range=0..100)
y軸方向_cm_5 = Slider(80, range=0..100)
x軸方向_cm_5 = Slider(50, range=0..100)
x軸方向_cm_6 = Slider(50, range=0..100)
y軸方向_cm_6 = Slider(80, range=0..100)
panel_39 = Panel("Column_2F_H")
panel_40 = Panel("Beam_KRF_A")
panel_41 = Panel("Beam_KRF_D")
panel_42 = Panel("Beam_HRF_S")
panel_43 = Panel("Beam_HRF_C")
multiplication_23 = Multiplication(A=せい_cm_8, B="10")
multiplication_24 = Multiplication(A=幅_cm_8, B="10")
multiplication_25 = Multiplication(A=x軸方向_cm_5, B="10")
multiplication_26 = Multiplication(A=y軸方向_cm_5, B="10")
multiplication_27 = Multiplication(A=x軸方向_cm_6, B="10")
multiplication_28 = Multiplication(A=y軸方向_cm_6, B="10")
stb_sec_12 = STbSection(Name="G_RF", STbMat=stb_mat, B=multiplication_24, H=multiplication_23, SectionType=0)  # disabled
stb_sec_13 = STbSection(Name="C_1F_H", STbMat=stb_mat, B=multiplication_26, H=multiplication_25, SectionType=0)
stb_sec_14 = STbSection(Name="C_2F_H", STbMat=stb_mat, B=multiplication_28, H=multiplication_27, SectionType=0)  # disabled
sec = STbSection([stb_sec_5, stb_sec_11, stb_sec_12, stb_sec_6, stb_sec_7, stb_sec_8, stb_sec_9, stb_sec_10, stb_sec_13, stb_sec_14, stb_sec, stb_sec_2, stb_sec_3, stb_sec_4])

# ---- group: スラスト力 / もう一方の桁行構面にかかる水平力
スラスト力②_kn = Slider(0, range=0..100)

# ---- group: スラスト力 / X軸上の桁行構面にかかる水平力
スラスト力①_kn = Slider(0, range=0..100)

# ---- group: 屋根構面の数 > 柱スパン数の場合に加える荷重 / もう一方の桁行構面RF梁中央にかかる水平力
水平力②_kn = Slider(0, range=0..100)

# ---- group: 屋根構面の数 > 柱スパン数の場合に加える荷重 / RF 梁の中心にはたらく鉛直荷重
鉛直荷重_kn = Slider(0, range=0..200)

# ---- group: 屋根構面の数 > 柱スパン数の場合に加える荷重 / X軸上の桁行構面RF梁中央にかかる水平力
水平力①_kn = Slider(0, range=0..100)

# ---- group: 重力
# 部材断面と密度を指定している部材の場合その自重が載荷される
# （荷重拾いのExcelファイル赤字部分）
stb_gload = STbGravityLoad(LC=0, Acceleration=Vector(0, 0, -9.80665))

# ----
# 3. 接合部の固定条件の指定
# ブレース（両端ピン接合）
# 梁・柱（両端剛接合）
# Karamba の Beam-Joints（解放 DOF なし）は剛接と同じなので、STB では不要です。
# （STB は EJNT が無い要素を剛接として扱います）
panel_49 = Panel("Beam_f_Kout")

# ----
# 立体架構解析プログラム（RC/梁間方向3スパン×桁行方向nスパン）
# 各自入力する値
# 1. モデル作成（節点・部材）
桁行方向_柱スパン_m = Slider(7.2, range=0..10)
_1f_柱高さ_m = Slider(10, range=0..10)
桁行方向_スパンの数 = Slider(10, range=0..10)
梁間方向_外側柱スパン_m = Slider(7.5, range=0..10)
梁間方向_中央柱スパン_m = Slider(7, range=0..10)

# ---- group: 桁行方向の全長
# 大グループ
桁行全長 = Multiplication(A=桁行方向_柱スパン_m, B=桁行方向_スパンの数)

# ---- group: 各フロア高さ
_2f高さ = Addition(A=_1f_柱高さ_m, B="0")

# ---- group: 梁間方向の各通りの座標指定
multiplication_29 = Multiplication(A=梁間方向_外側柱スパン_m, B="2")
b通りy = Addition(A=梁間方向_外側柱スパン_m, B="0")
c通りy = Addition(A=梁間方向_外側柱スパン_m, B=梁間方向_中央柱スパン_m)
d通りy = Addition(A=multiplication_29, B=梁間方向_中央柱スパン_m)

# ---- group: 基準節点の作成
_1f_a0 = ConstructPoint(XCoordinate=0, YCoordinate=0, ZCoordinate=0)
_1f_b0 = ConstructPoint(XCoordinate=0, YCoordinate=b通りy, ZCoordinate=0)
_1f_c0 = ConstructPoint(XCoordinate=0, YCoordinate=c通りy, ZCoordinate=0)
_1f_d0 = ConstructPoint(XCoordinate=0, YCoordinate=d通りy, ZCoordinate=0)
_1f_an = ConstructPoint(XCoordinate=桁行全長, YCoordinate=0, ZCoordinate=0)
_1f_bn = ConstructPoint(XCoordinate=桁行全長, YCoordinate=b通りy, ZCoordinate=0)
_1f_cn = ConstructPoint(XCoordinate=桁行全長, YCoordinate=c通りy, ZCoordinate=0)
_1f_dn = ConstructPoint(XCoordinate=桁行全長, YCoordinate=d通りy, ZCoordinate=0)
# 小グループ（注意点などの説明あり）
_2f_a0 = ConstructPoint(XCoordinate=0, YCoordinate=0, ZCoordinate=_2f高さ)
_2f_b0 = ConstructPoint(XCoordinate=0, YCoordinate=b通りy, ZCoordinate=[_1f_柱高さ_m, _2f高さ])
_2f_c0 = ConstructPoint(XCoordinate=0, YCoordinate=c通りy, ZCoordinate=[_1f_柱高さ_m, _2f高さ])
_2f_d0 = ConstructPoint(XCoordinate=0, YCoordinate=d通りy, ZCoordinate=[_1f_柱高さ_m, _2f高さ])
_2f_an = ConstructPoint(XCoordinate=桁行全長, YCoordinate=0, ZCoordinate=[_1f_柱高さ_m, _2f高さ])
_2f_bn = ConstructPoint(XCoordinate=桁行全長, YCoordinate=b通りy, ZCoordinate=[_1f_柱高さ_m, _2f高さ])
_2f_cn = ConstructPoint(XCoordinate=桁行全長, YCoordinate=c通りy, ZCoordinate=[_1f_柱高さ_m, _2f高さ])
_2f_dn = ConstructPoint(XCoordinate=桁行全長, YCoordinate=d通りy, ZCoordinate=[_1f_柱高さ_m, _2f高さ])

# ---- group: 水平ブレース（剛床設定用）
an_d0 = Line(StartPoint=_1f_an, EndPoint=_1f_d0)
a0_dn = Line(StartPoint=_1f_a0, EndPoint=_1f_dn)

# ---- group: 梁間方向（妻壁構面）の梁作成
_1f_a0_b0 = Line(StartPoint=_1f_a0, EndPoint=_1f_b0)
_1f_b0_c0 = Line(StartPoint=_1f_b0, EndPoint=_1f_c0)
_1f_c0_d0 = Line(StartPoint=_1f_c0, EndPoint=_1f_d0)
_1f_an_bn = Line(StartPoint=_1f_an, EndPoint=_1f_bn)
_1f_bn_cn = Line(StartPoint=_1f_bn, EndPoint=_1f_cn)
_1f_cn_dn = Line(StartPoint=_1f_cn, EndPoint=_1f_dn)
_2f_a0_b0 = Line(StartPoint=_2f_a0, EndPoint=_2f_b0)
_2f_b0_c0 = Line(StartPoint=_2f_b0, EndPoint=_2f_c0)
_2f_c0_d0 = Line(StartPoint=_2f_c0, EndPoint=_2f_d0)
_2f_an_bn = Line(StartPoint=_2f_an, EndPoint=_2f_bn)
_2f_bn_cn = Line(StartPoint=_2f_bn, EndPoint=_2f_cn)
_2f_cn_dn = Line(StartPoint=_2f_cn, EndPoint=_2f_dn)

# ---- group: 梁間方向（妻壁構面）の柱作成
_1f_a0_2 = Line(StartPoint=_1f_a0, EndPoint=_2f_a0)
_1f_b0_2 = Line(StartPoint=_1f_b0, EndPoint=_2f_b0)
_1f_c0_2 = Line(StartPoint=_1f_c0, EndPoint=_2f_c0)
_1f_d0_2 = Line(StartPoint=_1f_d0, EndPoint=_2f_d0)
_1f_an_2 = Line(StartPoint=_1f_an, EndPoint=_2f_an)
_1f_bn_2 = Line(StartPoint=_1f_bn, EndPoint=_2f_bn)
_1f_cn_2 = Line(StartPoint=_1f_cn, EndPoint=_2f_cn)
_1f_dn_2 = Line(StartPoint=_1f_dn, EndPoint=_2f_dn)

# ---- group: 桁行方向の梁の作成
_1f_a桁行 = Line(StartPoint=_1f_a0, EndPoint=_1f_an)
_1f_b桁行 = Line(StartPoint=_1f_b0, EndPoint=_1f_bn)
_1f_c桁行 = Line(StartPoint=_1f_c0, EndPoint=_1f_cn)
_1f_d桁行 = Line(StartPoint=_1f_d0, EndPoint=_1f_dn)
_2f_a桁行 = Line(StartPoint=_2f_a0, EndPoint=_2f_an)
_2f_d桁行 = Line(StartPoint=_2f_d0, EndPoint=_2f_dn)

# ---- group: 梁をスパン数に分割
div_a1f = DivideCurve(Curve=_1f_a桁行, Count=桁行方向_スパンの数, Kinks=False)  # -> Points, Tangents, Parameters
div_b1f = DivideCurve(Curve=_1f_b桁行, Count=桁行方向_スパンの数, Kinks=False)  # -> Points, Tangents, Parameters
div_c1f = DivideCurve(Curve=_1f_c桁行, Count=桁行方向_スパンの数, Kinks=False)  # -> Points, Tangents, Parameters
div_d1f = DivideCurve(Curve=_1f_d桁行, Count=桁行方向_スパンの数, Kinks=False)  # -> Points, Tangents, Parameters
div_a2f = DivideCurve(Curve=_2f_a桁行, Count=桁行方向_スパンの数, Kinks=False)  # -> Points, Tangents, Parameters
div_d2f = DivideCurve(Curve=_2f_d桁行, Count=桁行方向_スパンの数, Kinks=False)  # -> Points, Tangents, Parameters

# ---- group: 分割した桁行方向の梁
基礎梁_a = Shatter(Curve=_1f_a桁行, Parameters=div_a1f.Parameters)
基礎梁_b = Shatter(Curve=_1f_b桁行, Parameters=div_b1f.Parameters)
基礎梁_c = Shatter(Curve=_1f_c桁行, Parameters=div_c1f.Parameters)
基礎梁_d = Shatter(Curve=_1f_d桁行, Parameters=div_d1f.Parameters)
_2f梁_a = Shatter(Curve=_2f_a桁行, Parameters=div_a2f.Parameters)
_2f梁_d = Shatter(Curve=_2f_d桁行, Parameters=div_d2f.Parameters)

# ---- group: 妻壁（0通り）のブレース置換
a1f_b2f = Line(StartPoint=_1f_a0, EndPoint=_2f_b0)
a2f_b1f = Line(StartPoint=_2f_a0, EndPoint=_1f_b0)
b1f_c2f = Line(StartPoint=_1f_b0, EndPoint=_2f_c0)
b2f_c1f = Line(StartPoint=_2f_b0, EndPoint=_1f_c0)
c1f_d2f = Line(StartPoint=_1f_c0, EndPoint=_2f_d0)
c2f_d1f = Line(StartPoint=_2f_c0, EndPoint=_1f_d0)

# ---- group: 2F , RFに1Fと同様の分割節点を作成
panel_63 = Panel("""0
-1""")
cull_i = CullIndex(List=div_a1f.Points, Indices=panel_63, Wrap=True)
cull_i_2 = CullIndex(List=div_d1f.Points, Indices=panel_63, Wrap=True)
cull_i_3 = CullIndex(List=div_a2f.Points, Indices=panel_63, Wrap=True)
cull_i_4 = CullIndex(List=div_d2f.Points, Indices=panel_63, Wrap=True)
_1f_h = UnitZ(Factor=_2f高さ)
move = Move(Geometry=cull_i, Motion=_1f_h)  # -> Geometry, Transform
move_2 = Move(Geometry=cull_i_2, Motion=_1f_h)  # -> Geometry, Transform

# ----
# 2. 支持条件の指定
# 柱脚（基礎梁端部）
pt = Point(flatten([cull_i, cull_i_2, _1f_a0, _1f_b0, _1f_c0, _1f_d0, _1f_an, _1f_bn, _1f_cn, _1f_dn, div_c1f.Points, div_b1f.Points]))
stb_sup = STbSupport(Point=pt, Restraint0=True, Restraint1=True, Restraint2=True, Restraint3=False, Restraint4=False, Restraint5=False)
sup = STbSupport(stb_sup)

# ---- group: 各線材の作成
基礎梁_梁間方向 = Line(StartPoint=cull_i, EndPoint=cull_i_2)
division_3 = Division(A=b通りy, B=d通りy)
division_4 = Division(A=c通りy, B=d通りy)
_1f柱_a = Line(StartPoint=cull_i, EndPoint=move.Geometry)
shatter = Shatter(Curve=基礎梁_梁間方向, Parameters=[division_3, division_4])
_1f柱_d = Line(StartPoint=cull_i_2, EndPoint=move_2.Geometry)
panel_64 = Panel("""0
2""")
line = Line(shatter)
item = ListItem(List=line, Index=panel_64, Wrap=True)
item_2 = ListItem(List=line, Index="1", Wrap=True)

# ---- group: 妻壁（n通り）のブレース置換
c1f_d2f_2 = Line(StartPoint=_1f_cn, EndPoint=_2f_dn)
c2f_d1f_2 = Line(StartPoint=_2f_cn, EndPoint=_1f_dn)
a1f_b2f_2 = Line(StartPoint=_1f_an, EndPoint=_2f_bn)
a2f_b1f_2 = Line(StartPoint=_2f_an, EndPoint=_1f_bn)
b1f_c2f_2 = Line(StartPoint=_1f_bn, EndPoint=_2f_cn)
b2f_c1f_2 = Line(StartPoint=_2f_bn, EndPoint=_1f_cn)

# ---- group: 各線材を部材要素に変換
基礎梁1 = Line(flatten([基礎梁_a, 基礎梁_d]))
基礎梁4 = Line(flatten(item))
_2fl梁_桁行a = Line(flatten(_2f梁_a))
_1f隅柱 = Line(flatten([_1f_a0_2, _1f_d0_2, _1f_an_2, _1f_dn_2]))
dupln = RemoveDuplicateLines(Lines=flatten(基礎梁1), Tolerance=0.005)
dupln_2 = RemoveDuplicateLines(Lines=flatten(基礎梁4), Tolerance=0.005)
divide = DivideCurve(Curve=graft(dupln_2), Count=2, Kinks=False)  # -> Points, Tangents, Parameters
item_3 = ListItem(List=divide.Parameters, Index=1, Wrap=True)
dupln_3 = RemoveDuplicateLines(Lines=flatten(_2fl梁_桁行a), Tolerance=0.005)
divide_2 = DivideCurve(Curve=graft(dupln_3), Count=2, Kinks=False)  # -> Points, Tangents, Parameters
item_4 = ListItem(List=divide_2.Parameters, Index=1, Wrap=True)
dupln_4 = RemoveDuplicateLines(Lines=flatten(_1f隅柱), Tolerance=0.005)
shatter_2 = Shatter(Curve=graft(dupln_2), Parameters=item_3)
shatter_3 = Shatter(Curve=graft(dupln_3), Parameters=item_4)
stb_elem = STbElement(Name="Beam_f_Kout", Line=dupln, STbSection=stb_sec_5, Beta=0)
stb_elem_2 = STbElement(Name="Beam_f_HinS", Line=shatter_2, STbSection=stb_sec_5, Beta=0)
stb_elem_3 = STbElement(Name="Beam_K2F_A", Line=shatter_3, STbSection=stb_sec_11, Beta=0)
stb_elem_4 = STbElement(Name="Column_1F_C", Line=dupln_4, STbSection=stb_sec_6, Beta=0)
item_5 = ListItem(List=divide.Points, Index=1, Wrap=True)
item_6 = ListItem(List=divide_2.Points, Index=1, Wrap=True)
基礎梁2 = Line(flatten([基礎梁_b, 基礎梁_c]))
基礎梁5 = Line(flatten([_1f_b0_c0, _1f_bn_cn]))
_2fl梁_桁行d = Line(flatten(_2f梁_d))
_1f桁行側柱 = Line(flatten([_1f柱_a, _1f柱_d]))
dupln_5 = RemoveDuplicateLines(Lines=flatten(基礎梁2), Tolerance=0.005)
dupln_6 = RemoveDuplicateLines(Lines=flatten(基礎梁5), Tolerance=0.005)
divide_3 = DivideCurve(Curve=graft(dupln_6), Count=2, Kinks=False)  # -> Points, Tangents, Parameters
item_7 = ListItem(List=divide_3.Parameters, Index=1, Wrap=True)
dupln_7 = RemoveDuplicateLines(Lines=flatten(_2fl梁_桁行d), Tolerance=0.005)
divide_4 = DivideCurve(Curve=graft(dupln_7), Count=2, Kinks=False)  # -> Points, Tangents, Parameters
item_8 = ListItem(List=divide_4.Parameters, Index=1, Wrap=True)
dupln_8 = RemoveDuplicateLines(Lines=flatten(_1f桁行側柱), Tolerance=0.005)
shatter_4 = Shatter(Curve=graft(dupln_6), Parameters=item_7)
shatter_5 = Shatter(Curve=graft(dupln_7), Parameters=item_8)
stb_elem_5 = STbElement(Name="Beam_f_Kin", Line=dupln_5, STbSection=stb_sec_5, Beta=0)
stb_elem_6 = STbElement(Name="Beam_f_HoutC", Line=shatter_4, STbSection=stb_sec_5, Beta=0)
stb_elem_7 = STbElement(Name="Beam_K2F_D", Line=shatter_5, STbSection=stb_sec_11, Beta=0)
stb_elem_8 = STbElement(Name="Column_1F_K", Line=dupln_8, STbSection=stb_sec_9, Beta=0)
item_9 = ListItem(List=divide_3.Points, Index=1, Wrap=True)
item_10 = ListItem(List=divide_4.Points, Index=1, Wrap=True)
基礎梁3 = Line(flatten([_1f_a0_b0, _1f_c0_d0, _1f_an_bn, _1f_cn_dn]))
基礎梁6 = Line(flatten(item_2))
_2fl梁_梁間外側 = Line(flatten([_2f_a0_b0, _2f_c0_d0, _2f_an_bn, _2f_cn_dn]))
_1f梁間側柱 = Line(flatten([_1f_b0_2, _1f_c0_2, _1f_bn_2, _1f_cn_2]))
dupln_9 = RemoveDuplicateLines(Lines=flatten(基礎梁3), Tolerance=0.005)
divide_5 = DivideCurve(Curve=graft(dupln_9), Count=2, Kinks=False)  # -> Points, Tangents, Parameters
item_11 = ListItem(List=divide_5.Parameters, Index=1, Wrap=True)
dupln_10 = RemoveDuplicateLines(Lines=flatten(基礎梁6), Tolerance=0.005)
divide_6 = DivideCurve(Curve=graft(dupln_10), Count=2, Kinks=False)  # -> Points, Tangents, Parameters
item_12 = ListItem(List=divide_6.Parameters, Index=1, Wrap=True)
dupln_11 = RemoveDuplicateLines(Lines=flatten(_2fl梁_梁間外側), Tolerance=0.005)
dupln_12 = RemoveDuplicateLines(Lines=flatten(_1f梁間側柱), Tolerance=0.005)
shatter_6 = Shatter(Curve=graft(dupln_9), Parameters=item_11)
shatter_7 = Shatter(Curve=graft(dupln_10), Parameters=item_12)
stb_elem_9 = STbElement(Name="Beam_f_HoutS", Line=shatter_6, STbSection=stb_sec_5, Beta=0)
stb_elem_10 = STbElement(Name="Beam_f_HinC", Line=shatter_7, STbSection=stb_sec_5, Beta=0)
stb_elem_11 = STbElement(Name="Beam_H2F_S", Line=dupln_11, STbSection=stb_sec_11, Beta=0)
stb_elem_12 = STbElement(Name="Column_1F_H", Line=dupln_12, STbSection=stb_sec_13, Beta=0)
item_13 = ListItem(List=divide_5.Points, Index=1, Wrap=True)
item_14 = ListItem(List=divide_6.Points, Index=1, Wrap=True)
水平ブレース = Line(flatten([a0_dn, an_d0]))
_2fl梁_梁間中央 = Line(flatten([_2f_b0_c0, _2f_bn_cn]))
dupln_13 = RemoveDuplicateLines(Lines=flatten(水平ブレース), Tolerance=0.005)
dupln_14 = RemoveDuplicateLines(Lines=flatten(_2fl梁_梁間中央), Tolerance=0.005)
stb_elem_13 = STbElement(Name="Hor_Brace", Line=dupln_13, STbSection=stb_sec_8, Beta=0)
stb_elem_14 = STbElement(Name="Beam_H2F_C", Line=dupln_14, STbSection=stb_sec_11, Beta=0)

# ---- group: 各ブレース材を部材要素に変換
# ブレース材（妻壁置換）に関して
# 
# 長期荷重時に、建物にかかる各層の重量を求めたい場合
# →黒い「LineElem」部分を右クリックして「Enabled」をOFFにする
#  （OFF状態ではコンポーネントがグレーになります）
# 
# [注意点]
# 地震荷重をかけて短期の挙動を見るときは、
# ブレース材の「Enabled」をONに戻してください
_1fブレース_外側 = Line(flatten([a1f_b2f, a2f_b1f, c1f_d2f, c2f_d1f, a1f_b2f_2, a2f_b1f_2, c1f_d2f_2, c2f_d1f_2]))
_1fブレース_中央 = Line(flatten([b1f_c2f, b2f_c1f, b1f_c2f_2, b2f_c1f_2]))
dupln_15 = RemoveDuplicateLines(Lines=flatten(_1fブレース_外側), Tolerance=0.005)
dupln_16 = RemoveDuplicateLines(Lines=flatten(_1fブレース_中央), Tolerance=0.005)
stb_elem_15 = STbElement(Name="1FBraceS", Line=dupln_15, STbSection=stb_sec_2, Beta=0)
stb_elem_16 = STbElement(Name="1FBraceC", Line=dupln_16, STbSection=stb_sec, Beta=0)

# ----
stb_joint = STbJoint(STbElement=stb_elem_15, Ryi=0, Ryj=0)
elem = STbElement(stb_joint)

elem_2 = STbElement([stb_elem_3, stb_elem_2, stb_elem, stb_elem_6, stb_elem_5, stb_elem_7, stb_elem_9, stb_elem_10, stb_elem_11, stb_elem_14, stb_elem_13, stb_elem_16, stb_elem_4, stb_elem_8, stb_elem_12])

# ---- group: 計算用の各数値
梁間中央側スパン_m = Number(梁間方向_中央柱スパン_m)
梁間外側スパン_m = Number(梁間方向_外側柱スパン_m)
桁行柱スパン_m = Number(桁行方向_柱スパン_m)
_1f高さ_m = Number(_1f_柱高さ_m)
division_5 = Division(A=_1f高さ_m, B="2")
division_6 = Division(A=桁行柱スパン_m, B="2")
division_7 = Division(A=梁間外側スパン_m, B="2")
division_8 = Division(A=梁間中央側スパン_m, B="2")
division_9 = Division(A=division_7, B="2")

# ---- group: 上載荷重（＝屋根架構の支点反力）
# 屋根荷重（鉛直方向の支点反力）
# 別プログラムで求めた屋根架構の支点反力の値を入力
柱頂点の鉛直荷重_kn = Slider(100, range=0..200)
Z = UnitZ(Factor=柱頂点の鉛直荷重_kn)
neg = Negative(Value=Z)
pt_2 = Point(flatten([move.Geometry, move_2.Geometry, _2f_a0, _2f_d0, _2f_an, _2f_dn]))
stb_pload = STbPointLoad(Point=pt_2, LC=0, F=neg, M=Vector(0, 0, 0))

# ---- group: スラスト力
# 屋根架構支点にスラスト力が生じている場合は入力（ない場合は0、載荷する方向に注意）
Y = UnitY(Factor=スラスト力①_kn)
pt_3 = Point(flatten([move.Geometry, _2f_an, _2f_a0]))
Y_2 = UnitY(Factor=スラスト力②_kn)
pt_4 = Point(flatten([move_2.Geometry, _2f_d0, _2f_dn]))
neg_2 = Negative(Value=Y)
stb_pload_2 = STbPointLoad(Point=pt_3, LC=0, F=neg_2, M=Vector(0, 0, 0))
stb_pload_3 = STbPointLoad(Point=pt_4, LC=0, F=Y_2, M=Vector(0, 0, 0))

# ---- group: 屋根構面の数 > 柱スパン数の場合に加える荷重
# RF梁の中点に加える荷重
# 桁行方向の柱スパン数より屋根構面の数を多くしたい場合はここの値を入力
# 例）柱は 5 m× 8 スパン＝40 m の架構だが、屋根は 2.5 m× 16 スパン＝40 m にしたい場合など、
# 　　 柱スパン数の倍＝屋根構面の数の場合のみ対応
#  　　※柱は 5 m× 8 スパン＝40 m 、屋根は 4 m× 10 スパン＝40 mのような変則的なものは不可
# 
# 柱スパン数＝屋根構面の数（各柱の頂点にのみ屋根架構を渡す場合）はここの値は全て 0 でよい
# 鉛直方向の荷重
# 水平力（それぞれ力がかかる梁に注意）
Z_2 = UnitZ(Factor=鉛直荷重_kn)
Y_3 = UnitY(Factor=水平力①_kn)
Y_4 = UnitY(Factor=水平力②_kn)
neg_3 = Negative(Value=Y_3)
neg_4 = Negative(Value=Z_2)
stb_pload_4 = STbPointLoad(Point=[item_6, item_10], LC=0, F=neg_4, M=Vector(0, 0, 0))
stb_pload_5 = STbPointLoad(Point=item_6, LC=0, F=neg_3, M=Vector(0, 0, 0))
stb_pload_6 = STbPointLoad(Point=item_10, LC=0, F=Y_4, M=Vector(0, 0, 0))

# ----
# 7. 荷重条件の指定：短期（地震時）
# を選択すると載荷点が表示されます
# 1F：コーナーの柱１本にかかる水平力
# 1F：桁行構面の柱（コーナー以外）１本にかかる水平力
# 1F：梁間構面の柱（コーナー以外）１本にかかる水平力
# ※以下は長期荷重のところで「RF梁の中点に加える荷重」
# 　を入力した場合のみ分配割合を計算して入力すること
# 桁行構面の2F梁（X軸上の通り）の中央にかかる水平力
# 桁行構面の2F梁（もう一方の通り）の中央にかかる水平力
# 短期（地震時）の挙動を見る場合
# 
# ① 柱の位置別に求めた1本あたりの水平力を入力
# ② 載荷方向（桁行or梁間）を選び、載荷したい方向の地震力と
# 　  長期荷重の【両方】を「情報統合・解析」の Load に繋ぐ
# 
# 【注意点】
# ・以下の地震力：桁行方向or梁間方向のどちらかのみ繋ぐこと
# ・繋ぐ前にElement内のブレース材の「Enabled」をONにすること
pt_5 = Point()  # disabled
p1_c_kn = Slider(100, range=0..200)
p1_k_kn = Slider(100, range=0..200)
p1_h_kn = Slider(100, range=0..200)
p_rf_1_kn = Slider(0, range=0..200)
p_rf_2_kn = Slider(0, range=0..200)
_1f_c = Point(flatten([_2f_a0, _2f_d0, _2f_an, _2f_dn]))
_1f_k = Point(flatten([move.Geometry, move_2.Geometry]))
_1f_h_2 = Point(flatten([_2f_b0, _2f_c0, _2f_bn, _2f_cn]))
X = UnitX(Factor=p1_c_kn)
Y_5 = UnitY(Factor=p1_c_kn)
stb_pload_7 = STbPointLoad(Point=_1f_c, LC=0, F=X, M=Vector(0, 0, 0))
stb_pload_8 = STbPointLoad(Point=_1f_c, LC=0, F=Y_5, M=Vector(0, 0, 0))
Y_6 = UnitY(Factor=p_rf_1_kn)
stb_pload_9 = STbPointLoad(Point=item_6, LC=0, F=Y_6, M=Vector(0, 0, 0))
X_2 = UnitX(Factor=p1_k_kn)
Y_7 = UnitY(Factor=p1_k_kn)
stb_pload_10 = STbPointLoad(Point=_1f_k, LC=0, F=X_2, M=Vector(0, 0, 0))
stb_pload_11 = STbPointLoad(Point=_1f_k, LC=0, F=Y_7, M=Vector(0, 0, 0))
Y_8 = UnitY(Factor=p_rf_2_kn)
stb_pload_12 = STbPointLoad(Point=item_10, LC=0, F=Y_8, M=Vector(0, 0, 0))
X_3 = UnitX(Factor=p1_h_kn)
Y_9 = UnitY(Factor=p1_h_kn)
stb_pload_13 = STbPointLoad(Point=_1f_h_2, LC=0, F=X_3, M=Vector(0, 0, 0))
stb_pload_14 = STbPointLoad(Point=_1f_h_2, LC=0, F=Y_9, M=Vector(0, 0, 0))

# ----
# 地震力：桁行方向
# 【Karamba3D → StructuralToolBox 置換メモ】
# ・単位: STB は E/G/Fy を N/mm2、断面寸法を mm で入力します（Karamba は kN/cm2・cm）。
#   断面スライダー[cm]は ×10 して STb Section に入れています。材料の E/G は値を換算して直接入力しています。
# ・材料は STB では断面(STb Section)に付きます。Karamba で要素IDごとに割り当てていた材料を、対応する断面に割り当てました。
# ・要素名(Name)は Karamba の Identifier と同じです。STB Forces の Name で柱を選べます。
# ・Karamba の Concentrated（梁の t=0.5 集中荷重）は STB に相当機能が無いため、
#   該当梁を中点で分割し、中点節点に STb Point Load を掛けています。
# ・荷重ケース LC0 → STB の LC 0。P_K / P_H は元ファイル同様に未接続（LC 0）です。
# ・解析は「Run」トグルを True にすると実行されます（STB 本体のインストールが必要）。
# ・STB Forces は各要素の [始端, t, 終端] を返すので、List Item で t=0.5 の値だけを取り出して合計しています。
p_k = STbLoad(flatten([stb_pload_7, stb_pload_10, stb_pload_13, stb_pload_9, stb_pload_12]))

# ----
# 地震力：梁間方向
p_h = STbLoad(flatten([stb_pload_8, stb_pload_11, stb_pload_14]))

# ---- group: 耐力壁（梁間方向）壁重量
# 梁間方向の [ 耐力壁部分 ] の壁荷重
# 梁間方向（妻壁）は1FL～RFL までが耐力壁
見付面積当たり壁荷重_n_m2 = Slider(4800, range=0..5000)
panel_70 = Panel("1/1000")
panel_71 = Panel("1/1000")

# ---- group: 耐力壁（梁間方向）壁重量 / 1F外壁上部荷重 [kN/m]
multiplication_30 = Multiplication(A=見付面積当たり壁荷重_n_m2, B=division_5, C=panel_70)

# ---- group: 耐力壁（梁間方向）壁重量 / 1F外壁下部分
multiplication_31 = Multiplication(A=見付面積当たり壁荷重_n_m2, B=division_5, C=panel_71)

# ---- group: 耐力壁（梁間方向）壁重量 (continued)
Z_3 = UnitZ(Factor=multiplication_30)
Z_4 = UnitZ(Factor=multiplication_31)
neg_5 = Negative(Value=Z_3)
neg_6 = Negative(Value=Z_4)
stb_lload = STbLineLoad(STbElement=[stb_elem_11, stb_elem_14], LC=0, Global=True, LoadI=neg_5, LoadJ=neg_5, LineLoadShape=0)
stb_lload_2 = STbLineLoad(STbElement=[stb_elem_9, stb_elem_6], LC=0, Global=True, LoadI=neg_6, LoadJ=neg_6, LineLoadShape=0)

# ---- group: 非耐力壁（桁行方向）壁荷重
# 桁行方向 [ 非耐力壁 ] の壁荷重
# 桁行方向の壁は全て非耐力壁
見付面積当たり壁荷重_n_m2_2 = Slider(1500, range=0..2000)
panel_75 = Panel("1/1000")
panel_76 = Panel("1/1000")

# ---- group: 非耐力壁（桁行方向）壁荷重 / 1F外壁下部分荷重 [kN/m]
multiplication_32 = Multiplication(A=見付面積当たり壁荷重_n_m2_2, B=division_5, C=panel_76)

# ---- group: 非耐力壁（桁行方向）壁荷重 / 1F外壁上部荷重 [kN/m]
multiplication_33 = Multiplication(A=見付面積当たり壁荷重_n_m2_2, B=division_5, C=panel_75)

# ---- group: 非耐力壁（桁行方向）壁荷重 (continued)
Z_5 = UnitZ(Factor=multiplication_33)
Z_6 = UnitZ(Factor=multiplication_32)
neg_7 = Negative(Value=Z_5)
neg_8 = Negative(Value=Z_6)
stb_lload_3 = STbLineLoad(STbElement=[stb_elem_3, stb_elem_7], LC=0, Global=True, LoadI=neg_7, LoadJ=neg_7, LineLoadShape=0)
stb_lload_4 = STbLineLoad(STbElement=stb_elem, LC=0, Global=True, LoadI=neg_8, LoadJ=neg_8, LineLoadShape=0)

# ---- group: 非耐力壁（梁間方向）壁荷重
# 梁間方向の [ 非耐力壁部分 ] の壁荷重
# RFLより上のパラペット＋妻壁は非耐力壁
見付面積当たり壁荷重_n_m2_3 = Slider(1500, range=0..2000)
外側屋根高さ_m = Slider(3, range=0..10)
中央屋根高さ_m = Slider(5, range=0..10)
panel_80 = Panel("1/1000")
panel_81 = Panel("1/1000")
panel_82 = Panel("1/1000")

# ---- group: 非耐力壁（梁間方向）壁荷重 / パラペット部分の荷重 [kN/m]
a_b_c = Multiplication(A=見付面積当たり壁荷重_n_m2_3, C=panel_82)

# ---- group: 非耐力壁（梁間方向）壁荷重 / 外側スパンの屋根部分の壁 [kN/m]
a_b_c_2 = Multiplication(A=見付面積当たり壁荷重_n_m2_3, B=外側屋根高さ_m, C=panel_81)

# ---- group: 非耐力壁（梁間方向）壁荷重 / 中央スパンの屋根部分の壁荷重 [kN/m]
a_b_c_3 = Multiplication(A=見付面積当たり壁荷重_n_m2_3, B=中央屋根高さ_m, C=panel_80)

# ---- group: 非耐力壁（梁間方向）壁荷重 (continued)
Z_7 = UnitZ(Factor=a_b_c)
Z_8 = UnitZ(Factor=a_b_c_2)
Z_9 = UnitZ(Factor=a_b_c_3)
neg_9 = Negative(Value=Z_7)
neg_10 = Negative(Value=Z_8)
neg_11 = Negative(Value=Z_9)
stb_lload_5 = STbLineLoad(STbElement=stb_elem_11, LC=0, Global=True, LoadI=neg_9, LoadJ=neg_9, LineLoadShape=0)  # disabled
stb_lload_6 = STbLineLoad(STbElement=stb_elem_11, LC=0, Global=True, LoadI=neg_10, LoadJ=neg_10, LineLoadShape=0)
stb_lload_7 = STbLineLoad(STbElement=stb_elem_14, LC=0, Global=True, LoadI=neg_11, LoadJ=neg_11, LineLoadShape=0)

# ----
# 6. 荷重条件の指定：長期
# 妻壁をスパン毎に面積の等しい長方形に
# 置き換えたときの高さ [m] を入力
# （詳細は補足資料を参照）
panel_86 = Panel("2")
division_10 = Division(A=division_8, B=panel_86)
addition = Addition(A=division_9, B=division_10)
merge = Merge()
merge_2 = Merge()

# ---- group: 1F床荷重
床の単位積載重量_n_m2 = Slider(8290, range=0..10000)
multiplication_34 = Multiplication(A=床の単位積載重量_n_m2, B=division_6, C=division_9, D="2", E="1/1000")
panel_87 = Panel("1/1000")
multiplication_35 = Multiplication(A=division_6, B="2")
panel_88 = Panel("1/1000")
panel_89 = Panel("2")
panel_90 = Panel("2")
multiplication_36 = Multiplication(A=addition, B=division_6, C="2", D="1/1000", E=床の単位積載重量_n_m2)
division_11 = Division(A=multiplication_36, B=桁行柱スパン_m)
Z_10 = UnitZ(Factor=division_11)
neg_12 = Negative(Value=Z_10)
stb_lload_8 = STbLineLoad(STbElement=stb_elem_5, LC=0, Global=True, LoadI=neg_12, LoadJ=neg_12, LineLoadShape=0)

# ---- group: 1F床荷重 / 1F床荷重：梁間中央 [kN]
multiplication_37 = Multiplication(A=床の単位積載重量_n_m2, B=division_6, C=division_8, D=panel_89, E=panel_87)

# ---- group: 1F床荷重 / 1F床荷重：梁間外側 [kN]
multiplication_38 = Multiplication(A=床の単位積載重量_n_m2, B=division_6, C=division_7, D=panel_90, E=panel_88)

# ---- group: 1F床荷重 / 1F床荷重：桁行外端部 [kN/m]
division_12 = Division(A=multiplication_34, B=multiplication_35)

# ---- group: 1F床荷重 (continued)
Z_11 = UnitZ(Factor=multiplication_38)
Z_12 = UnitZ(Factor=multiplication_37)
Z_13 = UnitZ(Factor=division_12)
neg_13 = Negative(Value=Z_11)
neg_14 = Negative(Value=Z_12)
neg_15 = Negative(Value=Z_13)
stb_pload_15 = STbPointLoad(Point=[item_13, item_5], LC=0, F=neg_13, M=Vector(0, 0, 0))
stb_pload_16 = STbPointLoad(Point=[item_14, item_9], LC=0, F=neg_14, M=Vector(0, 0, 0))
stb_lload_9 = STbLineLoad(STbElement=stb_elem, LC=0, Global=True, LoadI=neg_15, LoadJ=neg_15, LineLoadShape=0)

# ----
長期荷重 = STbLoad(flatten([stb_pload_2, stb_pload_3, stb_pload, stb_gload, stb_lload_9, stb_lload_2, stb_lload_8, stb_pload_4, stb_pload_5, stb_pload_6, stb_lload_6, stb_lload_7, stb_lload_4, stb_lload_3]))

ld = STbLoad(flatten(長期荷重))
sec_2 = STbSection(sec)
# 情報統合・解析
elem_3 = STbElement(elem_2)
sup_2 = STbSupport(sup)
elem_4 = STbElement(elem)
mat_2 = STbMat(mat)
stb_model = STBAssembleModel(STbElement=flatten([elem_3, elem_4]), STbLoad=flatten(ld), STbSupport=flatten(sup_2), Write=False)  # -> Text, DAT, STbModel
stb_analyze = STbAnalyze(STbModel=stb_model.STbModel, Run=Toggle(False), LoadCase=-1)  # -> Success, ExitCode, OutPath, Stdout, Stderr, Summary, Results, STbModel
stb_def = STBDeformedShape(STbModel=stb_analyze.STbModel, LoadCase=0, Legend=True, Scale=100, ScaleMinimum=0, ScaleMaximum=1000)  # -> InitialPoints, DeformedPoints, DeformedLines, NodeIDs, DeformedCurves
view_sup = ViewSupportCondition(STbModel=stb_model.STbModel, Size=0.8)  # -> Points, Symbols, Conditions
stb_fdiagram = STBForceDiagram(STbModel=stb_analyze.STbModel, LoadCase=0, Divisions=8, Values=False, Legend=False, ComponentIndex=5, DiagramScale=0.01)  # -> Diagram, Values, ElementIDs

# ----
# を選択するとどの柱か表示されます
# この値を地震力計算用ExcelのW1、W2に入力して計算する
# 
# [注意点]
# ・この重量を求めるときは以下を確認
# 　→「長期荷重のみ」を載荷した状態になっているか
# 　→Element内のブレース材4種類は「Enabled」がOFFになっているか
# 
# ・地震力を求め終わった後は以下を確認
# 　→7. 荷重条件の設定（地震時）に入力している水平荷重は「柱1本あたり」になっているか
# 　→短期の挙動を見る際は、Element内のブレース材4種類の「Enabled」をONにしているか
panel_97 = Panel("Column_1F_H")
# 層重量計算
panel_98 = Panel("Column_1F_C")
stb_forces = STBForces(STbModel=stb_analyze.STbModel, LoadCase=0, Name=panel_98, T="0.5")  # -> ElementID, N, Vy, Vz, Mx, My, Mz
stb_forces_2 = STBForces(STbModel=stb_analyze.STbModel, LoadCase=0, Name="Column_1F_K", T="0.5")  # -> ElementID, N, Vy, Vz, Mx, My, Mz
stb_forces_3 = STBForces(STbModel=stb_analyze.STbModel, LoadCase=0, Name=panel_97, T="0.5")  # -> ElementID, N, Vy, Vz, Mx, My, Mz
item_15 = ListItem(List=stb_forces.N, Index=1, Wrap=True)
abs = Absolute(Value=flatten(item_15))  # -> simplify(flatten(Result))
ma = MassAddition(Input=flatten(abs))  # -> Result, PartialResults
item_16 = ListItem(List=stb_forces_2.N, Index=1, Wrap=True)
abs_2 = Absolute(Value=flatten(item_16))  # -> simplify(flatten(Result))
ma_2 = MassAddition(Input=flatten(abs_2))  # -> Result, PartialResults
item_17 = ListItem(List=stb_forces_3.N, Index=1, Wrap=True)
abs_3 = Absolute(Value=flatten(item_17))  # -> simplify(flatten(Result))
ma_3 = MassAddition(Input=flatten(abs_3))  # -> Result, PartialResults
a_b_c_4 = Addition(A=ma.Result, B=ma_2.Result, C=ma_3.Result)
subtraction = Subtraction(A=a_b_c_4)
line_2 = Line()  # disabled

# ----
# 層の重量 W1 [kN]
_1f重量_w1_kn = Panel(subtraction)

# ----
# 1F：コーナーの柱の軸力
# 4 本
各柱ごとの軸力_kn = Panel(abs)
_1f隅柱_2 = Line(flatten([_1f_a0_2, _1f_d0_2, _1f_an_2, _1f_dn_2]))
合計_kn = Panel(ma.Result)

# ----
# 1F：梁間方向（コーナー以外）の柱の軸力
# 4 本
各柱ごとの軸力_kn_2 = Panel(abs_3)
_1f梁間側柱_2 = Line(flatten([_1f_b0_2, _1f_c0_2, _1f_bn_2, _1f_cn_2]))
合計_kn_2 = Panel(ma_3.Result)

# ----
# 1F：桁行方向（コーナー以外）の柱の軸力
# （ スパン数ー 1 ）× 2 本
各柱ごとの軸力_kn_3 = Panel(abs_2)
合計_kn_3 = Panel(ma_2.Result)
_1f桁行側柱_2 = Line(flatten([_1f柱_a, _1f柱_d]))

# ---- group: 小梁自重
# 小梁の自重
# 小梁はモデル化せず、重量のみを荷重として加える
小梁の単位重量_n_m = Slider(2880, range=0..5000)
panel_99 = Panel("1/1000")
panel_100 = Panel("2")

# ---- group: 小梁自重 / 小梁自重 [kN]
multiplication_39 = Multiplication(A=小梁の単位重量_n_m, B=division_6, C=panel_100, D=panel_99)

# ---- group: 小梁自重 (continued)
Z_14 = UnitZ(Factor=multiplication_39)
Z_15 = UnitZ(Factor=multiplication_39)
neg_16 = Negative(Value=Z_14)
neg_17 = Negative(Value=Z_15)
stb_pload_17 = STbPointLoad(Point=[item_13, item_5], LC=0, F=neg_16, M=Vector(0, 0, 0))
stb_pload_18 = STbPointLoad(Point=[item_14, item_9], LC=0, F=neg_17, M=Vector(0, 0, 0))
